# Grasshopper definition AIA-GEO OPT-SESSION 01-EXERCISE 01-GERMAN BODENBENDER.gh (Grasshopper 1.0.7)

# AIA + GEOMETRY OPTIMIZATION
# EXERCISE 01  -  2021/04/20     //     GERMAN OTTO BODENBENDER
# 1. list
number_slider = Slider(10, range=0..10)
y_range = Slider(10, range=1..10)
x_range = Slider(10, range=1..10)
y_range_2 = Slider(10, range=1..10)
series = Series(Start=0, Step=1, Count=number_slider)
ghpython_script = GhPythonScript(x_range=x_range, y_range=y_range_2, divide_by=y_range, deg=Slider(3, range=1..5))  # -> out, series, pointsA, pointsB, lines, points, vec, veclen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; inputs x_range: Int32, divide_by: Int32, deg: Int32
# ---------- ghpython_script: Python ----------
# IAAC - MACAD
# AIA SEMESTER // GEOMETRY OPTIMIZATION SEMINAR
# STUDENT: German Otto Bodenbender
# ASSIGNMENT: 01 + 2021/04/20

# ----------------------------------------------------------------------------------------------

# IMPORTS
import Rhino.Geometry as rg
import Rhino as rh
import ghpythonlib.treehelpers as th #this one is to import nested lists to grasshopper trees
import math
import GhPython.Component as ghc


# USER INPUTS
x_range = int(x_range)
y_range = int(y_range)
divide_by = int(divide_by)
deg = int(deg)

# ----------------------------------------------------------------------------------------------


# 01 //  Create a range list using the X input
series = range(0,x_range,1)
print(series)
print(type(series))


# 02 // Create a point list using the "series" as an X input 
pointlistA = []
for i in series:
    p = rg.Point3d(i, 0, 0)
    pointlistA.append(p)
#print(len(pointlist))
pointsA = pointlistA


# 03 // Create a point list using the "series" as an X input and 10 as a Y input
pointlistB = []
for i in series:
    p = rg.Point3d(i, y_range, 0)
    pointlistB.append(p)
#print(len(pointlist))
pointsB = pointlistB


# 04 // Create a Line Curve between the list of points
linelist = []
for i in series:
    li = rg.Line(pointsA[i],pointsB[i])
    linelist.append(li)
lines = linelist


# 05 // Create NURBS from lines, divide them and assign points to division
nurby = []
allDivPts = []
alllinepts = []

for i in lines:
    linePts = []
    nu = rg.NurbsCurve.CreateFromLine(i)
    divide = nu.DivideByCount(divide_by, True)
    for p in divide:
        divPt = rg.Curve.PointAt(nu,p)
        linePts.append(divPt)
    allDivPts.append(linePts)
points = th.list_to_tree(allDivPts)


# 06 // SIN Function to the points and create vectors
allvec = []
allveclen = []
allvecsin = []
allvectorz = []
allnewpt = []
for i in allDivPts:
    veclen = []
    vec = []
    vecsin = []
    vecz = []
    newpt = []
    for c in i:
        v = rg.Vector3d(c)
        vec.append(v)
        vl = v.Length
        veclen.append(vl)
        vs = math.sin(vl)
        vecsin.append(vs)
        vz = rg.Vector3d(0,0,vs)
        vecz.append(vz)
        pt = c - vz
        newpt.append(pt)
    allvec.append(vec)
    allveclen.append(veclen)
    allvecsin.append(vecsin)
    allvectorz.append(vecz)
    allnewpt.append(newpt)
vectors = th.list_to_tree(allvec)
vectorslen = th.list_to_tree(allveclen)
vectorssin = th.list_to_tree(allvecsin)
vectors_z = th.list_to_tree(allvectorz)
newpoints = th.list_to_tree(allnewpt)


# 07 // Make a new curve using the newly created points
curves = []
for i in allnewpt:
    crv = rg.Curve.CreateInterpolatedCurve(i, deg)
    curves.append(crv)


# 08 // LOFT SURFACE
lofttype = rg.LoftType.Normal
ptun = rg.Point3d.Unset
loft = rg.Brep.CreateFromLoft(curves, ptun, ptun, lofttype, False)


# 09 // Create Mesh
mesh = rg.Mesh.CreateFromBrep(loft[0])

# END ---------------------------------------------------------------------
# ---------- end ghpython_script ----------

# ---- group: 1.
# 2. points
pt = ConstructPoint(XCoordinate=series, YCoordinate=0, ZCoordinate=0)

# ----
construct_point = ConstructPoint(XCoordinate=series, YCoordinate=Slider(10, range=0..10), ZCoordinate=0)
mesh = Mesh(ghpython_script.mesh)
point = Point(ghpython_script.newpoints)
curve = Curve(ghpython_script.curves)

# ---- group: 3.
# 3. line
ln = Line(StartPoint=pt, EndPoint=construct_point)

# ----
panel = Panel(ghpython_script.series)
panel_2 = Panel(ghpython_script.pointsA)
panel_3 = Panel(ghpython_script.pointsB)
panel_4 = Panel(ghpython_script.lines)
panel_5 = Panel(ghpython_script.points)
panel_6 = Panel(ghpython_script.vec)
panel_7 = Panel(ghpython_script.veclen)
panel_8 = Panel(ghpython_script.vectors)
panel_9 = Panel(ghpython_script.vectorslen)
panel_10 = Panel(ghpython_script.vectorssin)
panel_11 = Panel(ghpython_script.vectors_z)
panel_12 = Panel(point)
panel_13 = Panel(curve)
panel_14 = Panel(mesh)
panel_15 = Panel(ghpython_script.loft)

# ---- group: 4.
# 4. divide curve
divide = DivideCurve(Curve=ln, Count=10, Kinks=False)  # -> Points, Tangents, Parameters

# ---- group: 5.
vec = Vector(divide.Points)
vlen = VectorLength(Vector=vec)
sin = Sine(Value=vlen)
Z = UnitZ(Factor=sin)
# 5. vector
move = Move(Geometry=divide.Points, Motion=Z)  # -> Geometry, Transform

# ---- group: 6.
# 6. curve
intcrv = Interpolate(Vertices=move.Geometry, Degree=3, Periodic=False, KnotStyle=1)  # -> Curve, Length, Domain

# ----
# NOTES // POLYLINE & NURB
number_slider_2 = Slider(15, range=1..50)
ghpython_script_2 = GhPythonScript(x=number_slider_2)  # -> out, a, b, c, d, e, f; inputs x: Int32
# ---------- ghpython_script_2: Python ----------
import Rhino.Geometry as rg


pointlist = [1,2,3,4,5,6]
pointlist2 = []

for i in range(len(pointlist)):
    for j in range(len(pointlist)):
        for m in range(len(pointlist)):
            pt = rg.Point3d(i,j,m)
            pointlist2.append(pt)
    
e = pointlist2

# Create a polyline
poly = rg.Polyline(e)
nurb = rg.NurbsCurve.Create(True,3,e)



c = [poly]
d = [nurb]
# ---------- end ghpython_script_2 ----------
curve_2 = Curve(ghpython_script_2.c)
curve_3 = Curve(ghpython_script_2.d)

# ----
# NOTES // GRID OF POINTS
number_slider_3 = Slider(15, range=1..50)
ghpython_script_3 = GhPythonScript(x=number_slider_3)  # -> out, a, b, c, d, e, f; inputs x: Int32
# ---------- ghpython_script_3: Python ----------
import Rhino.Geometry as rg


pointlist = [1,2,3,4,5,6]
pointlist2 = []

for i in range(len(pointlist)):
    for j in range(len(pointlist)):
        for m in range(len(pointlist)):
            pt = rg.Point3d(i,j,m)
            pointlist2.append(pt)
    
e = pointlist2
# ---------- end ghpython_script_3 ----------
panel_16 = Panel(ghpython_script_3.e)

# ---- group: 7.
# 7. surface
loft = Loft(
    Curves=flatten(intcrv.Curve),
    Options={Adjust=False, Closed=False, LoftEnds=0, LoftSimp=0, LoftType=0, Rebuild=10, Refit=0.01})

# ---- group: 8.
# 8. mesh
mesh_uv = MeshSurface(Surface=loft, UCount=Slider(10, range=0..10), VCount=Slider(7, range=0..10), Overhang=True, Equalize=False)
