# Grasshopper definition AIA-GEO OPT-SESSION 02-EXERCISE 02-GERMAN BODENBENDER.gh (Grasshopper 1.0.7)
# plug-ins: Kangaroo2 Components, Heteroptera

# AIA + GEOMETRY OPTIMIZATION
# EXERCISE 01  -  2021/04/20     //     GERMAN OTTO BODENBENDER
# 1. list
number_slider = Slider(10, range=0..10)
y_range = Slider(10, range=1..10)
x_range = Slider(10, range=1..10)
y_range_2 = Slider(10, range=1..10)
file_path = FilePath("D:\German Profile\Desktop\GeoOpt\a01\test.py")
series = Series(Start=0, Step=1, Count=number_slider)
read_file = ReadFile(File=file_path, PerLineParse=False)
ghpython_script = GhPythonScript(x_range=x_range, y_range=y_range_2, divide_by=y_range, deg=Slider(3, range=1..5))  # -> out, series, pointsA, pointsB, lines, points, vec, veclen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; inputs x_range: Int32, divide_by: Int32, deg: Int32
# ---------- ghpython_script: Python ----------
# IAAC - MACAD
# AIA SEMESTER // GEOMETRY OPTIMIZATION SEMINAR
# STUDENT: German Otto Bodenbender
# ASSIGNMENT: 01 + 2021/04/20

# ----------------------------------------------------------------------------------------------

# IMPORTS
import Rhino.Geometry as rg
import Rhino as rh
import ghpythonlib.treehelpers as th #this one is to import nested lists to grasshopper trees
import math
import GhPython.Component as ghc


# USER INPUTS
x_range = int(x_range)
y_range = int(y_range)
divide_by = int(divide_by)
deg = int(deg)

# ----------------------------------------------------------------------------------------------


# 01 //  Create a range list using the X input
series = range(0,x_range,1)
print(series)
print(type(series))


# 02 // Create a point list using the "series" as an X input 
pointlistA = []
for i in series:
    p = rg.Point3d(i, 0, 0)
    pointlistA.append(p)
#print(len(pointlist))
pointsA = pointlistA


# 03 // Create a point list using the "series" as an X input and 10 as a Y input
pointlistB = []
for i in series:
    p = rg.Point3d(i, y_range, 0)
    pointlistB.append(p)
#print(len(pointlist))
pointsB = pointlistB


# 04 // Create a Line Curve between the list of points
linelist = []
for i in series:
    li = rg.Line(pointsA[i],pointsB[i])
    linelist.append(li)
lines = linelist


# 05 // Create NURBS from lines, divide them and assign points to division
nurby = []
allDivPts = []
alllinepts = []

for i in lines:
    linePts = []
    nu = rg.NurbsCurve.CreateFromLine(i)
    divide = nu.DivideByCount(divide_by, True)
    for p in divide:
        divPt = rg.Curve.PointAt(nu,p)
        linePts.append(divPt)
    allDivPts.append(linePts)
points = th.list_to_tree(allDivPts)


# 06 // SIN Function to the points and create vectors
allvec = []
allveclen = []
allvecsin = []
allvectorz = []
allnewpt = []
for i in allDivPts:
    veclen = []
    vec = []
    vecsin = []
    vecz = []
    newpt = []
    for c in i:
        v = rg.Vector3d(c)
        vec.append(v)
        vl = v.Length
        veclen.append(vl)
        vs = math.sin(vl)
        vecsin.append(vs)
        vz = rg.Vector3d(0,0,vs)
        vecz.append(vz)
        pt = c - vz
        newpt.append(pt)
    allvec.append(vec)
    allveclen.append(veclen)
    allvecsin.append(vecsin)
    allvectorz.append(vecz)
    allnewpt.append(newpt)
vectors = th.list_to_tree(allvec)
vectorslen = th.list_to_tree(allveclen)
vectorssin = th.list_to_tree(allvecsin)
vectors_z = th.list_to_tree(allvectorz)
newpoints = th.list_to_tree(allnewpt)


# 07 // Make a new curve using the newly created points
curves = []
for i in allnewpt:
    crv = rg.Curve.CreateInterpolatedCurve(i, deg)
    curves.append(crv)


# 08 // LOFT SURFACE
lofttype = rg.LoftType.Normal
ptun = rg.Point3d.Unset
loft = rg.Brep.CreateFromLoft(curves, ptun, ptun, lofttype, False)


# 09 // Create Mesh
mesh = rg.Mesh.CreateFromBrep(loft[0])

# END ---------------------------------------------------------------------
# ---------- end ghpython_script ----------

# ---- group: 1.
# 2. points
pt = ConstructPoint(XCoordinate=series, YCoordinate=0, ZCoordinate=0)

# ----
construct_point = ConstructPoint(XCoordinate=series, YCoordinate=Slider(10, range=0..10), ZCoordinate=0)
ghpython_script_2 = GhPythonScript(Code=read_file)  # -> Out, A
mesh = Mesh(ghpython_script.mesh)
point = Point(ghpython_script.newpoints)
curve = Curve(ghpython_script.curves)

# ---- group: 3.
# 3. line
ln = Line(StartPoint=pt, EndPoint=construct_point)

# ----
panel = Panel(ghpython_script.series)
panel_2 = Panel(ghpython_script.pointsA)
panel_3 = Panel(ghpython_script.pointsB)
panel_4 = Panel(ghpython_script.lines)
panel_5 = Panel(ghpython_script.points)
panel_6 = Panel(ghpython_script.vec)
panel_7 = Panel(ghpython_script.veclen)
panel_8 = Panel(ghpython_script.vectors)
panel_9 = Panel(ghpython_script.vectorslen)
panel_10 = Panel(ghpython_script.vectorssin)
panel_11 = Panel(ghpython_script.vectors_z)
panel_12 = Panel(point)
panel_13 = Panel(curve)
panel_14 = Panel(mesh)
panel_15 = Panel(ghpython_script.loft)

# ---- group: 4.
# 4. divide curve
divide = DivideCurve(Curve=ln, Count=10, Kinks=False)  # -> Points, Tangents, Parameters

# ---- group: 5.
vec = Vector(divide.Points)
vlen = VectorLength(Vector=vec)
sin = Sine(Value=vlen)
Z = UnitZ(Factor=sin)
# 5. vector
move = Move(Geometry=divide.Points, Motion=Z)  # -> Geometry, Transform

# ----
y_range_3 = Slider(10, range=1..10)
# EXERCISE 02: CREATE MESH
# DAI APPROACH
x_range_2 = Slider(10, range=1..10)
y_range_4 = Slider(10, range=1..10)
# CREATING A MESH FORM 4 POINTS
# CREATING A MESH THE POINTS
point_2 = Point([<point referenced from the Rhino model> x4])
ghpython_script_3 = GhPythonScript(pts=point_2)  # -> out, a; inputs pts: list of Point3d
# ---------- ghpython_script_3: Python ----------
import Rhino.Geometry as rg

#Create a Mesh
#You first create a mesh as an empty container and then 
#you add info onto it.

mesh = rg.Mesh()
mesh1 = rg.Mesh()
print mesh.Vertices


#Once you create an empy mesh, you then add info.
#Below we added the points to it.
for p in pts:
    mesh.Vertices.Add(p)
print mesh.Vertices

#This will output an invalid mesh, bcs a mesh cannot
#have just points, it also needs faces
a = mesh

#We add a Face to the mesh using the vertices
#After we do this, automatically we have a valid mesh
mesh.Faces.AddFace(0,1,2,3)
# ---------- end ghpython_script_3 ----------
panel_16 = Panel(ghpython_script_3.a)
ghpython_script_4 = GhPythonScript(x_range=x_range_2, y_range=y_range_4, divide_by=y_range_3, deg=Slider(3, range=1..5))  # -> out, series, pointsA, pointsB, lines, points, vec, veclen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; inputs x_range: Int32, divide_by: Int32, deg: Int32
# ---------- ghpython_script_4: Python ----------
# IAAC - MACAD
# AIA SEMESTER // GEOMETRY OPTIMIZATION SEMINAR
# STUDENT: German Otto Bodenbender
# ASSIGNMENT: 01 + 2021/04/20

# ----------------------------------------------------------------------------------------------

# IMPORTS
import Rhino.Geometry as rg
import Rhino as rh
import ghpythonlib.treehelpers as th #this one is to import nested lists to grasshopper trees
import math
import GhPython.Component as ghc


# USER INPUTS
x_range = int(x_range)
y_range = int(y_range)
divide_by = int(divide_by)
deg = int(deg)

# ----------------------------------------------------------------------------------------------


# 01 //  Create a range list using the X input
series = range(0,x_range,1)
print(series)
print(type(series))


# 02 // Create a point list using the "series" as an X input 
pointlistA = []
for i in series:
    p = rg.Point3d(i, 0, 0)
    pointlistA.append(p)
#print(len(pointlist))
pointsA = pointlistA


# 03 // Create a point list using the "series" as an X input and 10 as a Y input
pointlistB = []
for i in series:
    p = rg.Point3d(i, y_range, 0)
    pointlistB.append(p)
#print(len(pointlist))
pointsB = pointlistB


# 04 // Create a Line Curve between the list of points
linelist = []
for i in series:
    li = rg.Line(pointsA[i],pointsB[i])
    linelist.append(li)
lines = linelist


# 05 // Create NURBS from lines, divide them and assign points to division
nurby = []
allDivPts = []
alllinepts = []

for i in lines:
    linePts = []
    nu = rg.NurbsCurve.CreateFromLine(i)
    divide = nu.DivideByCount(divide_by, True)
    for p in divide:
        divPt = rg.Curve.PointAt(nu,p)
        linePts.append(divPt)
    allDivPts.append(linePts)
points = th.list_to_tree(allDivPts)


# 06 // SIN Function to the points and create vectors
allvec = []
allveclen = []
allvecsin = []
allvectorz = []
allnewpt = []
for i in allDivPts:
    veclen = []
    vec = []
    vecsin = []
    vecz = []
    newpt = []
    for c in i:
        v = rg.Vector3d(c)
        vec.append(v)
        vl = v.Length
        veclen.append(vl)
        vs = math.sin(vl)
        vecsin.append(vs)
        vz = rg.Vector3d(0,0,vs)
        vecz.append(vz)
        pt = c - vz
        newpt.append(pt)
    allvec.append(vec)
    allveclen.append(veclen)
    allvecsin.append(vecsin)
    allvectorz.append(vecz)
    allnewpt.append(newpt)
vectors = th.list_to_tree(allvec)
vectorslen = th.list_to_tree(allveclen)
vectorssin = th.list_to_tree(allvecsin)
vectors_z = th.list_to_tree(allvectorz)
newpoints = th.list_to_tree(allnewpt)


# 07 // Make a new curve using the newly created points
curves = []
for i in allnewpt:
    crv = rg.Curve.CreateInterpolatedCurve(i, deg)
    curves.append(crv)


# 08 // LOFT SURFACE
lofttype = rg.LoftType.Normal
ptun = rg.Point3d.Unset
loft = rg.Brep.CreateFromLoft(curves, ptun, ptun, lofttype, False)


# 09 // Create Mesh
mesh = rg.Mesh.CreateFromBrep(loft[0])

# END ---------------------------------------------------------------------

flattenlist = []
for ptList in newpoints:
    for pts in ptList:
        flattenlist.append(pts)

sorted_points = []

for i in range(len(flattenlist)-(V+2)):
    sub = []
    if ( i!=V and ((i-V) % (i+V)) or i==0):
        for j in range(1):
            point1 = flattenlist[i]
            point2 = flattenlist[i+1]
            point3 = flattenlist[i+V+2]
            point4 = flattenlist[i+V+1]
            sub.append([point1, point2, point3, point4])
    sorted_points.append(sub)

print sorted_points

g = th.list_to_tree(sorted_points)


"""
msh_vertices = []
mesh_faces = []

mesh = rg.Mesh()

for p in sorted_points:
    sub = []
    for j in range(4):
        a = mesh.Vertices.Add(p[j])
        sub.append(a)
    mesh_vertices.append(sub)

for i in mesh_vertices:
    face = rg.MeshFace(i[0], i[1], i[2],i[3])
    mesh.Faces
"""
# ---------- end ghpython_script_4 ----------

# ---- group: 6.
# 6. curve
intcrv = Interpolate(Vertices=move.Geometry, Degree=3, Periodic=False, KnotStyle=1)  # -> Curve, Length, Domain

# ----
mesh_2 = Mesh(ghpython_script_4.mesh)
point_3 = Point(ghpython_script_4.newpoints)
curve_2 = Curve(ghpython_script_4.curves)
panel_17 = Panel(ghpython_script_4.series)
panel_18 = Panel(ghpython_script_4.pointsA)
panel_19 = Panel(ghpython_script_4.pointsB)
panel_20 = Panel(ghpython_script_4.lines)
panel_21 = Panel(ghpython_script_4.points)
panel_22 = Panel(ghpython_script_4.vec)
panel_23 = Panel(ghpython_script_4.veclen)
panel_24 = Panel(ghpython_script_4.vectors)
panel_25 = Panel(ghpython_script_4.vectorslen)
panel_26 = Panel(ghpython_script_4.vectorssin)
panel_27 = Panel(ghpython_script_4.vectors_z)
panel_28 = Panel(point_3)
panel_29 = Panel(curve_2)
panel_30 = Panel(mesh_2)
panel_31 = Panel(ghpython_script_4.loft)

# ----
# NOTES // POLYLINE & NURB
number_slider_2 = Slider(15, range=1..50)
ghpython_script_5 = GhPythonScript(x=number_slider_2)  # -> out, a, b, c, d, e, f; inputs x: Int32
# ---------- ghpython_script_5: Python ----------
import Rhino.Geometry as rg


pointlist = [1,2,3,4,5,6]
pointlist2 = []

for i in range(len(pointlist)):
    for j in range(len(pointlist)):
        for m in range(len(pointlist)):
            pt = rg.Point3d(i,j,m)
            pointlist2.append(pt)
    
e = pointlist2

# Create a polyline
poly = rg.Polyline(e)
nurb = rg.NurbsCurve.Create(True,3,e)



c = [poly]
d = [nurb]
# ---------- end ghpython_script_5 ----------
curve_3 = Curve(ghpython_script_5.c)
curve_4 = Curve(ghpython_script_5.d)

# ----
# NOTES // GRID OF POINTS
number_slider_3 = Slider(15, range=1..50)
ghpython_script_6 = GhPythonScript(x=number_slider_3)  # -> out, a, b, c, d, e, f; inputs x: Int32
# ---------- ghpython_script_6: Python ----------
import Rhino.Geometry as rg


pointlist = [1,2,3,4,5,6]
pointlist2 = []

for i in range(len(pointlist)):
    for j in range(len(pointlist)):
        for m in range(len(pointlist)):
            pt = rg.Point3d(i,j,m)
            pointlist2.append(pt)
    
e = pointlist2
# ---------- end ghpython_script_6 ----------
panel_32 = Panel(ghpython_script_6.e)

# ---- group: 7.
# 7. surface
loft = Loft(
    Curves=flatten(intcrv.Curve),
    Options={Adjust=False, Closed=False, LoftEnds=0, LoftSimp=0, LoftType=0, Rebuild=10, Refit=0.01})

# ---- group: 8.
# 8. mesh
mesh_uv = MeshSurface(Surface=loft, UCount=Slider(10, range=0..10), VCount=Slider(7, range=0..10), Overhang=True, Equalize=False)

# ----
y_range_5 = Slider(10, range=1..10)
# CREATING A MESH THE POINTS
# EXERCISE 02: CREATE MESH
# DAI APPROACH
x_range_3 = Slider(10, range=1..10)
y_range_6 = Slider(10, range=1..10)
ghpython_script_7 = GhPythonScript(x_range=x_range_3, y_range=y_range_6, divide_by=y_range_5, deg=Slider(3, range=1..5))  # -> out, series, pointsA, pointsB, lines, points, vec, veclen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; inputs x_range: Int32, divide_by: Int32, deg: Int32
# ---------- ghpython_script_7: Python ----------
# IAAC - MACAD
# AIA SEMESTER // GEOMETRY OPTIMIZATION SEMINAR
# STUDENT: German Otto Bodenbender
# ASSIGNMENT: 01 + 2021/04/20

# ----------------------------------------------------------------------------------------------

# IMPORTS
import Rhino.Geometry as rg
import Rhino as rh
import ghpythonlib.treehelpers as th #this one is to import nested lists to grasshopper trees
import math
import GhPython.Component as ghc


# USER INPUTS
x_range = int(x_range)
y_range = int(y_range)
divide_by = int(divide_by)
deg = int(deg)

# ----------------------------------------------------------------------------------------------


# 01 //  Create a range list using the X input
series = range(0,x_range,1)
print(series)
print(type(series))


# 02 // Create a point list using the "series" as an X input 
pointlistA = []
for i in series:
    p = rg.Point3d(i, 0, 0)
    pointlistA.append(p)
#print(len(pointlist))
pointsA = pointlistA


# 03 // Create a point list using the "series" as an X input and 10 as a Y input
pointlistB = []
for i in series:
    p = rg.Point3d(i, y_range, 0)
    pointlistB.append(p)
#print(len(pointlist))
pointsB = pointlistB


# 04 // Create a Line Curve between the list of points
linelist = []
for i in series:
    li = rg.Line(pointsA[i],pointsB[i])
    linelist.append(li)
lines = linelist


# 05 // Create NURBS from lines, divide them and assign points to division
nurby = []
allDivPts = []
alllinepts = []

for i in lines:
    linePts = []
    nu = rg.NurbsCurve.CreateFromLine(i)
    divide = nu.DivideByCount(divide_by, True)
    for p in divide:
        divPt = rg.Curve.PointAt(nu,p)
        linePts.append(divPt)
    allDivPts.append(linePts)
points = th.list_to_tree(allDivPts)


# 06 // SIN Function to the points and create vectors
allvec = []
allveclen = []
allvecsin = []
allvectorz = []
allnewpt = []
for i in allDivPts:
    veclen = []
    vec = []
    vecsin = []
    vecz = []
    newpt = []
    for c in i:
        v = rg.Vector3d(c)
        vec.append(v)
        vl = v.Length
        veclen.append(vl)
        vs = math.sin(vl)
        vecsin.append(vs)
        vz = rg.Vector3d(0,0,vs)
        vecz.append(vz)
        pt = c - vz
        newpt.append(pt)
    allvec.append(vec)
    allveclen.append(veclen)
    allvecsin.append(vecsin)
    allvectorz.append(vecz)
    allnewpt.append(newpt)
vectors = th.list_to_tree(allvec)
vectorslen = th.list_to_tree(allveclen)
vectorssin = th.list_to_tree(allvecsin)
vectors_z = th.list_to_tree(allvectorz)
newpoints = th.list_to_tree(allnewpt)


# 07 // Make a new curve using the newly created points
curves = []
for i in allnewpt:
    crv = rg.Curve.CreateInterpolatedCurve(i, deg)
    curves.append(crv)


# 08 // LOFT SURFACE
lofttype = rg.LoftType.Normal
ptun = rg.Point3d.Unset
loft = rg.Brep.CreateFromLoft(curves, ptun, ptun, lofttype, False)


# 09 // Create Mesh
mesh = rg.Mesh.CreateFromBrep(loft[0])

# END ---------------------------------------------------------------------
"""
flattenlist = []
for ptList in newpoints:
    for pts in ptList:
        flattenlist.append(pts)

mesh = rg.Mesh()

for i in range(len(newpoints)-1):
    for j in range(len(newpoints[i])-1):
        m = rg.Mesh()
        v1 = newpoints[i][j]
        v2 = newpoints[i][j+1]
        v3 = newpoints[i+1][j+1]
        v4 = newpoints[i+1][j]
        
        m.Vertices.Add(v1)
        m.Vertices.Add(v2)
        m.Vertices.Add(v3)
        m.Vertices.Add(v4)
        
        b.Faces.AddFace(0,1,2,3)
        mesh.Append(m)



mesh.Vertices.CullUnused()
mesh.Weld(3.14)
g = mesh

#Calculate the normals
mesh.FaceNormals.ComputeFaceNormals()
mesh.Normals.ComputeNormals()


"""
# ---------- end ghpython_script_7 ----------
mesh_3 = Mesh(ghpython_script_7.mesh)
point_4 = Point(ghpython_script_7.newpoints)
curve_5 = Curve(ghpython_script_7.curves)
panel_33 = Panel(ghpython_script_7.series)
panel_34 = Panel(ghpython_script_7.pointsA)
panel_35 = Panel(ghpython_script_7.pointsB)
panel_36 = Panel(ghpython_script_7.lines)
panel_37 = Panel(ghpython_script_7.points)
panel_38 = Panel(ghpython_script_7.vec)
panel_39 = Panel(ghpython_script_7.veclen)
panel_40 = Panel(ghpython_script_7.vectors)
panel_41 = Panel(ghpython_script_7.vectorslen)
panel_42 = Panel(ghpython_script_7.vectorssin)
panel_43 = Panel(ghpython_script_7.vectors_z)
panel_44 = Panel(point_4)
panel_45 = Panel(curve_5)
panel_46 = Panel(mesh_3)
panel_47 = Panel(ghpython_script_7.loft)
panel_48 = Panel(ghpython_script_7.newpoints)
number_slider_4 = Slider(0.083, range=0..1)
point_5 = Point(Point(10.68810376, 7.050368357, 0))
sphere = Sphere(Base=point_5, Radius=Slider(9, range=1..20))
area = Area(Geometry=sphere)  # -> Area, Centroid
bounding_box = BoundingBox(Content=sphere, Plane=PlaneXY(0, 0, 0))  # -> Box, Box_2
populate_3d = Populate3D(Region=bounding_box.Box, Count=Slider(40, range=1..100), Seed=1)
line = Line(StartPoint=area.Centroid, EndPoint=populate_3d)
evaluate_curve = EvaluateCurve(Curve=reparameterize(line), Parameter=Slider(0.2, range=0..1))  # -> Point, Tangent, Angle
plane_normal = PlaneNormal(Origin=evaluate_curve.Point, ZAxis=line)
brep = Brep(<brep referenced from the Rhino model>)
brep_plane = BrepPlane(Brep=brep, Plane=plane_normal)  # -> Curves, Points
number_slider_5 = Slider(0.07, range=0.01..1)
curve_6 = Curve(flatten(brep_plane.Curves))
pipe = Pipe(Curve=brep_plane.Curves, Radius=number_slider_5, Caps=0)
evaluate_curve_2 = EvaluateCurve(Curve=reparameterize(curve_6), Parameter=Slider(0.6, range=0..1))  # -> flatten(Point), Tangent, Angle
divide_curve = DivideCurve(Curve=curve_6, Count=10, Kinks=False)  # -> flatten(Points), Tangents, Parameters
split_list = SplitList(List=divide_curve.Points, Index=Slider(400, range=-10..400))  # -> ListA, ListB
kinky_curve = KinkyCurve(Vertices=split_list.ListA, Degree=3, Angle=0.1745329252)  # -> Curve, Length, Domain
nurbs_curve = NurbsCurve(Vertices=split_list.ListA, Degree=2, Periodic=True)  # -> Curve, Length, Domain
min_max = MinMax(Number=split_list.ListA)  # -> Minimum, Maximum
nurbs_curve_2 = NurbsCurve(Vertices=divide_curve.Points, Degree=3, Periodic=True)  # -> Curve, Length, Domain
list_length = ListLength(List=split_list.ListA)
panel_49 = Panel(nurbs_curve.Curve)
length = Length(Curve=nurbs_curve_2.Curve)
length_2 = Length(Curve=nurbs_curve.Curve)
multipipe = MultiPipe(Curves=nurbs_curve.Curve, NodeSize=number_slider_5, EndOffset=1, StrutSize=1, Segment=0, KinkAngle=0.6, CubeFit=0)
gradient = Gradient(LowerLimit=0, UpperLimit=length, Parameter=length_2, stops=[0: RGB(255, 192, 192), 1: RGB(205, 92, 92)])
panel_50 = Panel(curve_6)
custom_preview = CustomPreview(Geometry=multipipe, Material=gradient)
