# Grasshopper definition AIA-GeoOpt-Session-4.gh (Grasshopper 1.0.7)
# plug-ins: Hops, Kangaroo2 Components

pt = Point(Point(26.82950961, 29.16368214, 0))
pt_2 = Point(Point(-21.57514339, -20.94908372, 11.68385586))
list = ValueList({"edgeLength", "sameWeight"}, selected="edgeLength")
list_2 = ValueList({"vertexGraph", "faceGraph"}, selected="faceGraph")
list_3 = ValueList({"dijkstra": "dijkstra_path", "shortest": "shortest_path"}, selected="dijkstra")
ln = Line(StartPoint=pt, EndPoint=pt_2)
mesh = Mesh(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)
panel = Panel("http://127.0.0.1:5000/MeshPathWalker")
bbox = BoundingBox(Content=mesh, Plane=PlaneXY(0, 0, 0))  # -> Box, Box_2
debrep = DeconstructBrep(Brep=bbox.Box)  # -> Faces, Edges, Vertices
number_slider = Slider(0.66, range=0..1)
number_slider_2 = Slider(0.22, range=0..1)
number_slider_3 = Slider(0.58, range=0..1)
number_slider_4 = Slider(0.05, range=0..1)
item = ListItem(List=debrep.Faces, Index=0, Wrap=True)  # -> Item, Item1, Item2
vec = VectorXYZ(XComponent=number_slider_2, YComponent=number_slider, ZComponent=0)  # -> Vector, Length
vec_2 = VectorXYZ(XComponent=number_slider_4, YComponent=number_slider_3, ZComponent=0)  # -> Vector, Length
evalsrf = EvaluateSurface(Surface=reparameterize(item.Item), Point=vec.Vector)  # -> Point, Normal, UDirection, VDirection, Frame
evalsrf_2 = EvaluateSurface(Surface=reparameterize(item.Item2), Point=vec_2.Vector)  # -> Point, Normal, UDirection, VDirection, Frame
ln_2 = Line(StartPoint=evalsrf.Point, EndPoint=evalsrf_2.Point)
hops = Hops(
    Mesh=mesh,
    WeightMode=list,
    GraphType=list_2,
    SLine=ln,
    Mode=list_3,
    CacheResultsInMemory=True,
    CacheSolveResults=True,
    RemoteDefinitionLocation="http://127.0.0.1:5000/MeshPathWalker",
    RemoteSolveVersion=(0, 1, 0))  # -> ShortestPath, FacesIndex
python = GhPythonScript(m=mesh)  # -> out, a; inputs m: Mesh
# ---------- python: Python ----------
import Rhino.Geometry as rg

mL = []

for f in range(m.Faces.Count):
    tempM = m.Duplicate()
    mL.append(tempM.Faces.ExtractFaces([f]))
    
a = mL
# ---------- end python ----------
dot = DotDisplay(Point=hops.ShortestPath)
galapagos = Galapagos(fitness=area, gene=[number_slider, number_slider_2, number_slider_3, number_slider_4])
item_2 = ListItem(List=python.a, Index=hops.FacesIndex, Wrap=True)
mjoin = MeshJoin(Meshes=item_2)
area = Area(Geometry=mjoin)  # -> Area, Centroid
