# Grasshopper definition AIA-EXERCISE 05-MESH SHORTEST PATH.gh (Grasshopper 1.0.7)
# plug-ins: Hops, Kangaroo2 Components, LunchBox, Human

mesh = Mesh(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)
triremesh = TriRemesh(Geometry=mesh, Iterations=25)  # -> Triangulation, Dual, Creases
mesh_edges = MeshEdges(Mesh=triremesh.Triangulation)  # -> NakedEdges, InteriorEdges, NonManifoldEdges
join_curves = JoinCurves(Curves=mesh_edges.NakedEdges, Preserve=False)
curve = Curve(join_curves)
number_slider = Slider(0.603, range=0.59..0.94)
number_slider_2 = Slider(0.361, range=0.12..0.43)
evaluate_curve = EvaluateCurve(Curve=reparameterize(curve), Parameter=Slider(0.859, range=0..5))  # -> Point, Tangent, Angle
seam = Seam(Curve=curve, Seam=evaluate_curve.Point)
evaluate_curve_2 = EvaluateCurve(Curve=reparameterize(seam), Parameter=number_slider_2)  # -> Point, Tangent, Angle
evaluate_curve_3 = EvaluateCurve(Curve=reparameterize(seam), Parameter=number_slider)  # -> Point, Tangent, Angle
ln = Line(StartPoint=evaluate_curve_3.Point, EndPoint=evaluate_curve_2.Point)

helicoid_surface = HelicoidSurface(
    UDivisions=100,
    VDivisions=100,
    RParameter=2,
    TParameter=1,
    Scale=5,
    Domain1=Domain(-6.283185307, 6.283185307),
    Domain2=Domain(-3.141592654, 3.141592654))
triremesh_2 = TriRemesh(Geometry=helicoid_surface, Iterations=25)  # -> Triangulation, Dual, Creases
brep_edges = BrepEdges(Brep=helicoid_surface)  # -> Naked, Interior, NonManifold
deconstruct_mesh = DeconstructMesh(Mesh=helicoid_surface)  # -> Vertices, Faces, Colours, Normals
number_slider_3 = Slider(0.48, range=0..1)
number_slider_4 = Slider(0.54, range=0..1)
list_item = ListItem(List=brep_edges.Naked, Index=Slider(0, range=0..145), Wrap=True)
list_item_2 = ListItem(List=brep_edges.Naked, Index=Slider(2, range=0..145), Wrap=True)
curve_2 = Curve(list_item_2)
curve_3 = Curve(list_item)
evaluate_curve_4 = EvaluateCurve(Curve=reparameterize(curve_2), Parameter=number_slider_3)  # -> Point, Tangent, Angle
evaluate_curve_5 = EvaluateCurve(Curve=reparameterize(curve_3), Parameter=number_slider_4)  # -> Point, Tangent, Angle
ln_2 = Line(StartPoint=evaluate_curve_4.Point, EndPoint=evaluate_curve_5.Point)

# ----
# AIA // GEOMETRY OPTIMIZATION
# STUDENT: German Otto Bodenbender
# EXERCISE 05 + 2021/05/27
mesh_2 = Mesh(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)
bbox = BoundingBox(Content=mesh_2, Plane=PlaneXY(0, 0, 0))  # -> Box, Box_2
debrep = DeconstructBrep(Brep=bbox.Box)  # -> Faces, Edges, Vertices
number_slider_5 = Slider(0.16, range=0..1)
number_slider_6 = Slider(0.44, range=0..1)
number_slider_7 = Slider(0.15, range=0..1)
number_slider_8 = Slider(0.5, range=0..1)
item = ListItem(List=debrep.Faces, Index=0, Wrap=True)  # -> Item, Item1, Item2, Item3, Item4, Item5
vec = VectorXYZ(XComponent=number_slider_5, YComponent=number_slider_6, ZComponent=0)  # -> Vector, Length
vec_2 = VectorXYZ(XComponent=number_slider_7, YComponent=number_slider_8, ZComponent=0)  # -> Vector, Length
surface = Surface(item.Item5)
surface_2 = Surface(item.Item4)
evalsrf = EvaluateSurface(Surface=reparameterize(surface), Point=vec.Vector)  # -> Point, Normal, UDirection, VDirection, Frame
evalsrf_2 = EvaluateSurface(Surface=reparameterize(surface_2), Point=vec_2.Vector)  # -> Point, Normal, UDirection, VDirection, Frame
line = Line(StartPoint=evalsrf.Point, EndPoint=evalsrf_2.Point)

# ----
# MESH 03
mesh_3 = Mesh(triremesh.Triangulation)
# MESH 01
mesh_4 = Mesh(mesh_2)
# MESH 02
mesh_5 = Mesh(triremesh_2.Triangulation)

list = ValueList({"edgeLength", "sameWeight"}, selected="edgeLength")
list_2 = ValueList({"vertexGraph", "faceGraph"}, selected="faceGraph")
list_3 = ValueList({"dijkstra": "dijkstra_path", "shortest": "shortest_path"}, selected="shortest")
curve_4 = Curve(ln)
mesh_6 = Mesh(mesh_3)

panel = Panel("http://127.0.0.1:5000/MeshPathWalker")
hops = Hops(
    Mesh=mesh_6,
    WeightMode=list,
    GraphType=list_2,
    SLine=curve_4,
    Mode=list_3,
    CacheResultsInMemory=True,
    CacheSolveResults=True,
    RemoteDefinitionLocation="http://127.0.0.1:5000/MeshPathWalker",
    RemoteSolveVersion=(0, 1, 0))  # -> ShortestPath, FacesIndex
python = GhPythonScript(m=mesh_6)  # -> out, a; inputs m: Mesh
# ---------- python: Python ----------
import Rhino.Geometry as rg

mL = []

for f in range(m.Faces.Count):
    tempM = m.Duplicate()
    mL.append(tempM.Faces.ExtractFaces([f]))
    
a = mL
# ---------- end python ----------
dot = DotDisplay(Point=hops.ShortestPath)
item_2 = ListItem(List=python.a, Index=hops.FacesIndex, Wrap=True)
mjoin = MeshJoin(Meshes=item_2)
area = Area(Geometry=mjoin)  # -> Area, Centroid

data = Data(curve_4)
extend_curve = ExtendCurve(Curve=data, Type=0, Start=Slider(6.5, range=0.1..20), End=Slider(10.4, range=0.1..20))
area_2 = Area(Geometry=mesh_6)  # -> Area, Centroid
unit_z = UnitZ(Factor=Slider(27, range=1..50))
extend_curve_2 = ExtendCurve(Curve=extend_curve, Type=0, Start=Slider(2.7, range=0.1..20), End=Slider(2.3, range=0.1..20))
move = Move(Geometry=area_2.Centroid, Motion=unit_z)  # -> Geometry, Transform
list_length = ListLength(List=item_2)
mesh_edges_2 = MeshEdges(Mesh=mesh_6)  # -> NakedEdges, InteriorEdges, NonManifoldEdges
series = Series(Start=0, Step=1, Count=list_length)
number_slider_9 = Slider(3, range=0.1..10)
colour_swatch = ColourSwatch(SwatchColor=RGB(61, 61, 61))
integer = Integer(area.Area)
dash_pattern = DashPattern(Curve=extend_curve, Pattern=Slider(1.6, range=0.1..5))  # -> Dashes, Gaps
end_points = EndPoints(Curve=extend_curve_2)  # -> Start, End
point = Point(Point(1.139534277, -0.677449781, 53.15901234))
gradient = Gradient(
    LowerLimit=0,
    UpperLimit=list_length,
    Parameter=series,
    stops=[0: RGB(0, 128, 0), 0.5: RGB(255, 255, 0), 1: RGB(255, 0, 0)])
concatenate = Concatenate(Fragment_A="PATH AREA", C="// ", Fragment_B=integer, A=" SQM")
xz_plane = XZPlane(Origin=move.Geometry)
xz_plane_2 = XZPlane(Origin=end_points.Start)
xz_plane_3 = XZPlane(Origin=end_points.End)

# ----
# MESH 01
galapagos = Galapagos(fitness=area, gene=[number_slider_6, number_slider_5, number_slider_8, number_slider_7])
# MESH 02
galapagos_2 = Galapagos(fitness=area, gene=[number_slider_4, number_slider_3])
# MESH 03
galapagos_3 = Galapagos(fitness=area, gene=[number_slider, number_slider_2])
custom_preview = CustomPreview(Geometry=flatten(item_2), Material=flatten(gradient))
custom_preview_2 = CustomPreview(Geometry=mesh_6, Material=ColourSwatch(SwatchColor=RGBA(64, 64, 64, 44)))
custom_preview_lineweights = CustomPreviewLineweights(
    Geometry=mesh_edges_2.NakedEdges,
    Shader=ColourSwatch(SwatchColor=RGB(0, 0, 0)),
    Thickness=Slider(2.5, range=0.1..10),
    Absolute=False)
custom_preview_lineweights_2 = CustomPreviewLineweights(
    Geometry=mesh_edges_2.InteriorEdges,
    Shader=ColourSwatch(SwatchColor=RGBA(158, 158, 158, 189)),
    Thickness=Slider(0.1, range=0.1..10),
    Absolute=False)
custom_preview_lineweights_3 = CustomPreviewLineweights(
    Geometry=dash_pattern.Dashes,
    Shader=ColourSwatch(SwatchColor=RGB(0, 0, 0)),
    Thickness=Slider(2.5, range=0.1..10),
    Absolute=False)
text_tag = TextTag(Location=xz_plane_2, Text="A", Colour=colour_swatch)
text_tag_2 = TextTag(Location=xz_plane_3, Text="B", Colour=colour_swatch)
text_tag_3 = TextTag(Location=xz_plane, Text=concatenate, Colour=colour_swatch)
